# Grasshopper definition M4.gh (Grasshopper 1.0.7)

pt = ConstructPoint(XCoordinate=0, YCoordinate=0, ZCoordinate=Slider(3, range=0..10))
ellipse = Ellipse(Plane=pt, Radius1=Slider(18, range=0..100), Radius2=Slider(9, range=0..10))  # -> Ellipse, Focus1, Focus2
geo = Geometry(ellipse.Focus2)
area = Area(Geometry=ellipse.Ellipse)  # -> Area, Centroid
ln = Line(StartPoint=geo, EndPoint=area.Centroid)
curvepoint = PointOnCurve(ln, parameter=0.621)
yz = YZPlane(Origin=curvepoint)
boundary = BoundarySurfaces(Edges=ellipse.Ellipse)
planesrf = PlaneSurface(Plane=yz, XSize=Domain(-10, 10), YSize=Domain(-10, 10))
bbx = BrepBrep(BrepA=planesrf, BrepB=boundary)  # -> Curves, Points
srfsplit = SurfaceSplit(Surface=boundary, Curves=bbx.Curves)
dispatch = Dispatch(List=srfsplit, DispatchPattern=[True, False])  # -> ListA, ListB
crv = Curve(dispatch.ListA)
explode = Explode(Curve=crv, Recursive=True)  # -> Segments, Vertices
number_slider = Slider(10, range=0..100)
evalsrf = EvaluateSurface(Surface=reparameterize(ellipse.Ellipse), Point="0.39, 0.5")  # -> Point, Normal, UDirection, VDirection, Frame
item = ListItem(List=explode.Segments, Index=Slider(1, range=0..1), Wrap=True)
scale = Scale(Geometry=item, Center=evalsrf.Point, Factor=Slider(0.2, range=0..1))  # -> Geometry, Transform
scale_2 = Scale(Geometry=scale.Geometry, Center=evalsrf.Point, Factor=Slider(2.1, range=0..10))  # -> Geometry, Transform
divide = DivideCurve(Curve=item, Count=number_slider, Kinks=False)  # -> Points, Tangents, Parameters
divide_2 = DivideCurve(Curve=scale.Geometry, Count=number_slider, Kinks=False)  # -> Points, Tangents, Parameters
ln_2 = Line(StartPoint=divide.Points, EndPoint=divide_2.Points)
cat = Catenary(PointA=divide_2.Points, PointB=divide.Points, Length=Slider(12, range=0..100), Gravity=scale.Geometry)
flip = FlipCurve(Curve=cat, Guide=ln_2)  # -> Curve, Flag
number_slider_2 = Slider(14, range=0..100)
reb = RebuildCurve(Curve=flip.Curve, Degree=Slider(3, range=0..10), Count=10, Tangents=False)
loft = Loft(Curves=reb, Options={Adjust=False, Closed=False, LoftEnds=0, LoftSimp=0, LoftType=0, Rebuild=10, Refit=0.01})
divide_3 = DivideCurve(Curve=reb, Count=number_slider_2, Kinks=False)  # -> Points, Tangents, Parameters
flip_2 = FlipMatrix(Data=divide_3.Points)
pipe = Pipe(Curve=reb, Radius=Slider(0.04, range=0..1), Caps=0)
intcrv = Interpolate(Vertices=flip_2, Degree=3, Periodic=False, KnotStyle=1)  # -> Curve, Length, Domain
cull_i = CullIndex(List=flatten(intcrv.Curve), Indices=[number_slider_2, "0"], Wrap=True)
pipe_2 = Pipe(Curve=cull_i, Radius=Slider(0.04, range=0..0.1), Caps=0)
