# Grasshopper definition FCD_V6.gh (Grasshopper 1.0.7)
# plug-ins: LunchBox, Kangaroo2 Components

# ---- group: Triangulation Inner Surface
number_slider = Slider(30, range=0..100)

# ---- group: Number of Triangulations
# 1. Allows to change the number of panels and the density of the space frame
# 2. cahnges the number of panels in each zone converted from the distance of the sun
# 3. Change the thickness of the space frame members
# 4. Change the ration of opaque to transparent to translucent panels
number_slider_2 = Slider(20, range=0..100)

# ---- group: Percentage in each Zone
number_slider_3 = Slider(0.55, range=0.2..0.8)

# ---- group: Pipe Thickness
member_thickness = Slider(0.05, range=0..0.1)

# ---- group: Customization of Number of Each Panel
number_slider_4 = Slider(6, range=0..10)
number_slider_5 = Slider(3, range=0..10)

# ---- group: Base Geometry / Starting Surface
srf = Surface(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)

# ---- group: Interior Panels
srf_2 = Surface(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)
area = Area(Geometry=srf_2)  # -> Area, Centroid
deconstruct = Deconstruct(Point=area.Centroid)  # -> XComponent, YComponent, ZComponent
construct_point = ConstructPoint(XCoordinate=deconstruct.XComponent, YCoordinate=deconstruct.YComponent, ZCoordinate=0)
scale_nu = ScaleNU(Geometry=srf_2, Plane=construct_point, ScaleX="1.02083", ScaleY="1.02083", ScaleZ="1.02083")  # -> Geometry, Transform
trib = TrianglePanelsB(Surface=[scale_nu.Geometry, srf_2], UDivisions=number_slider, VDivisions=number_slider)
# Creating the interior facade panels
bang = ExplodeTree(Data=trib)  # -> Branch0, Branch1
area_2 = Area(Geometry=trib)  # -> Area, Centroid
bang_2 = ExplodeTree(Data=area_2.Centroid)  # -> Branch0, Branch1
vec2pt = Vector2Pt(PointA=bang_2.Branch0, PointB=bang_2.Branch1, Unitize=False)  # -> Vector, Length
extr = Extrude(Base=bang.Branch0, Direction=vec2pt.Vector)
lng = ListLength(List=extr)
division = Division(A=lng, B=Slider(2, range=2..10))
dom = ConstructDomain(DomainStart=0, DomainEnd=lng)
random = Random(Range=dom, Number=division, Seed=2)

# ----
panel = Panel("Triangulating Base Geometry")

# ---- group: Sun Path Control Point
crv = Curve(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)
end = EndPoints(Curve=crv)  # -> Start, End
ln = Line(StartPoint=end.Start, EndPoint=end.End)
# Will use the sun to split the structure into two zones allowing for different programs such as reading and naping areas
rotax = RotateAxis(Geometry=crv, Angle=expr("-x", degrees(Slider(202, range=202..244))), Axis=ln)  # -> Geometry, Transform
eval = EvaluateCurve(Curve=reparameterize(rotax.Geometry), Parameter=Slider(0.5, range=0..1))  # -> Point, Tangent, Angle

# ----
srf_3 = Surface()

# ---- group: Interior Panels / Translucent Inner Panels
cull_i = CullIndex(List=extr, Indices=random, Wrap=True)

# ---- group: Interior Panels / Glass Inner Panels
item = ListItem(List=extr, Index=random, Wrap=True)

# ----
number_slider_6 = Slider(3.5, range=0..10)
panel_2 = Panel("72")
# creating glass panels according to zone and randomly generated seed
panel_3 = Panel("31")

# ---- group: Base Geometry / Offset Surface
number_slider_7 = Slider(1.06, range=0..10)

# ---- group: Outer Panel 1
area_3 = Area(Geometry=srf)  # -> Area, Centroid
deconstruct_2 = Deconstruct(Point=area_3.Centroid)  # -> XComponent, YComponent, ZComponent
construct_point_2 = ConstructPoint(XCoordinate=deconstruct_2.XComponent, YCoordinate=deconstruct_2.YComponent, ZCoordinate=0)
addition = Addition(A=number_slider_7, B="0.002")
addition_2 = Addition(A=addition, B="0.02083")
scale_nu_2 = ScaleNU(Geometry=srf, Plane=construct_point_2, ScaleX=addition, ScaleY=addition, ScaleZ=addition)  # -> Geometry, Transform
scale_nu_3 = ScaleNU(Geometry=srf, Plane=construct_point_2, ScaleX=addition_2, ScaleY=addition_2, ScaleZ=addition_2)  # -> Geometry, Transform
trib_2 = TrianglePanelsB(Surface=[scale_nu_2.Geometry, scale_nu_3.Geometry], UDivisions=number_slider_2, VDivisions=number_slider_2)
# Creation of extruded exterior facade
bang_3 = ExplodeTree(Data=trib_2)  # -> Branch0, Branch1
area_4 = Area(Geometry=trib_2)  # -> Area, Centroid
bang_4 = ExplodeTree(Data=area_4.Centroid)  # -> Branch0, Branch1
vec2pt_2 = Vector2Pt(PointA=bang_4.Branch0, PointB=bang_4.Branch1, Unitize=False)  # -> Vector, Length
extr_2 = Extrude(Base=bang_3.Branch0, Direction=vec2pt_2.Vector)

# ---- group: Base Geometry / Offset Surface (continued)
scale_nu_4 = ScaleNU(Geometry=srf, Plane=construct_point_2, ScaleX=number_slider_7, ScaleY=number_slider_7, ScaleZ=number_slider_7)  # -> Geometry, Transform

# ---- group: Base Geometry
trib_3 = TrianglePanelsB(Surface=[scale_nu_4.Geometry, srf], UDivisions=number_slider_2, VDivisions=number_slider_2)

# ---- group: Space Frame
edges = BrepEdges(Brep=trib_3)  # -> Naked, Interior, NonManifold
# Creating a space frame while also splitting the frame into parts of joints and pipes
pshift = ShiftPaths(Data=edges.Naked, Offset=-1)
bang_5 = ExplodeTree(Data=pshift)  # -> Branch0, Branch1
explode = Explode(Curve=bang_5.Branch0, Recursive=True)  # -> Segments, Vertices
explode_2 = Explode(Curve=bang_5.Branch1, Recursive=True)  # -> Segments, Vertices
end_2 = EndPoints(Curve=explode_2.Segments)  # -> Start, End
end_3 = EndPoints(Curve=explode.Segments)  # -> Start, End
pt = Point(end_2.End)
pt_2 = Point(end_3.End)
ln_2 = Line(StartPoint=pt_2, EndPoint=pt)
panel_4 = Panel("""0.1
0.9""")
panel_5 = Panel("""0.1
0.9""")
eval_2 = EvaluateCurve(Curve=reparameterize(graft(edges.Naked)), Parameter=panel_4)  # -> simplify(Point), Tangent, Angle
end_4 = EndPoints(Curve=graft(edges.Naked))  # -> simplify(Start), simplify(End)
end_5 = EndPoints(Curve=ln_2)  # -> simplify(Start), simplify(End)
eval_3 = EvaluateCurve(Curve=reparameterize(ln_2), Parameter=panel_5)  # -> simplify(Point), Tangent, Angle
item_2 = ListItem(List=eval_2.Point, Index=0, Wrap=True)  # -> Item, Item1
item_3 = ListItem(List=eval_3.Point, Index=0, Wrap=True)  # -> Item, Item1
ln_3 = Line(StartPoint=end_5.Start, EndPoint=item_3.Item)
ln_4 = Line(StartPoint=item_3.Item1, EndPoint=end_5.End)
ln_5 = Line(StartPoint=end_4.Start, EndPoint=item_2.Item)
ln_6 = Line(StartPoint=end_4.End, EndPoint=item_2.Item1)
ln_7 = Line(StartPoint=item_3.Item, EndPoint=item_3.Item1)
wood = Line(StartPoint=item_2.Item, EndPoint=item_2.Item1)
subtraction = Subtraction(A=member_thickness, B="0.01")
end_offset = Slider(0.01, range=0..0.1)
segment = Slider(0.2, range=0..1)
boolean_toggle = BooleanToggle(False)

# ---- group: Space Frame / joint
merge = Merge(Data1=ln_6, Data2=ln_5, Data3=ln_4, Data4=ln_3)  # -> flatten(Result)

# ---- group: Transparency
dist = Distance(PointA=eval.Point, PointB=bang_4.Branch0)
bnd = Bounds(Numbers=dist)
remap = RemapNumbers(Value=dist, Source=bnd, Target=Domain(0, 1))  # -> Mapped, Clipped
panel_6 = Panel(remap.Mapped)
larger = LargerThan(FirstNumber=remap.Mapped, SecondNumber=number_slider_3)  # -> LargerThan, OrEqualTo
reduce = RandomReduce(List=extr_2, Reduction=Slider(990, range=0..1000), Seed=Slider(100, range=0..100))

# ---- group: Space Frame / Joint Connectors
multipipe = MultiPipe(
    Curves=merge,
    NodeSize=member_thickness,
    EndOffset=end_offset,
    StrutSize=1,
    Segment=segment,
    KinkAngle=0.6,
    CubeFit=boolean_toggle,
    Caps=0)

# ---- group: Space Frame / Joints
pipe = Pipe(Curve=[wood, ln_7], Radius=subtraction, Caps=0)

# ---- group: Transparency
dispatch = Dispatch(List=extr_2, DispatchPattern=larger.LargerThan)  # -> ListA, ListB

# ---- group: Transparency / More Sun
brep = Brep(dispatch.ListB)

# ---- group: Transparency / Less Sun
brep_2 = Brep(dispatch.ListA)

# ---- group: Transparency
lng_2 = ListLength(List=brep)
number_slider_8 = Slider(72, range=0..100)
dom_2 = ConstructDomain(DomainStart=0, DomainEnd=lng_2)
division_2 = Division(A=lng_2, B=number_slider_5)
random_2 = Random(Range=dom_2, Number=division_2, Seed=number_slider_8, Integers=True)

# ---- group: Transparency / Glass Outer Reading Area
item_4 = ListItem(List=brep, Index=random_2, Wrap=True)

# ---- group: Transparency
multiplication = Multiplication(A=number_slider_5, B=number_slider_4)
lng_3 = ListLength(List=brep_2)
division_3 = Division(A=lng_3, B=multiplication)
dom_3 = ConstructDomain(DomainStart=0, DomainEnd=lng_3)
number_slider_9 = Slider(31, range=0..100)
random_3 = Random(Range=dom_3, Number=division_3, Seed=number_slider_9)
cull_i_2 = CullIndex(List=brep_2, Indices=random_3, Wrap=True)
lng_4 = ListLength(List=cull_i_2)
division_4 = Division(A=lng_4, B=multiplication)
dom_4 = ConstructDomain(DomainStart=0, DomainEnd=lng_4)

# ---- group: Transparency / Glass Outer Reading Area
item_5 = ListItem(List=brep_2, Index=random_3, Wrap=True)

# ----
# seperating apaque and translucent from remaining panels according to zone and randomly generated seed
multiplication_2 = Multiplication(A=division_4, B=Slider(2, range=0..10))

# ---- group: Transparency (continued)
random_4 = Random(Range=dom_4, Number=multiplication_2, Seed=number_slider_9)

# ---- group: Transparency / Translucent Outer Naping Area
item_6 = ListItem(List=cull_i_2, Index=random_4, Wrap=True)

# ---- group: Transparency / Opaque Outer Naping Area
cull_i_3 = CullIndex(List=cull_i_2, Indices=random_4, Wrap=True)

# ---- group: Transparency
cull_i_4 = CullIndex(List=brep, Indices=random_2, Wrap=True)
lng_5 = ListLength(List=cull_i_4)
dom_5 = ConstructDomain(DomainStart=0, DomainEnd=lng_5)
division_5 = Division(A=lng_5, B=number_slider_5)

# ----
division_6 = Division(A=division_5, B=Slider(2, range=0..10))

# ---- group: Transparency (continued)
random_5 = Random(Range=dom_5, Number=division_6, Seed=number_slider_8)

# ---- group: Transparency / TTranslucent Outer Reading Area
item_7 = ListItem(List=cull_i_4, Index=random_5, Wrap=True)

# ---- group: Transparency / Opaque Outer Reading Area
cull_i_5 = CullIndex(List=cull_i_4, Indices=random_5, Wrap=True)

# ---- group: Result
swatch = ColourSwatch(SwatchColor=RGBA(69, 23, 23, 26))
swatch_2 = ColourSwatch(SwatchColor=RGB(255, 255, 255))
swatch_3 = ColourSwatch(SwatchColor=RGBA(158, 65, 65, 73))
opaque_panels = CustomPreview(Geometry=[cull_i_3, cull_i_5], Material=ColourSwatch(SwatchColor=RGB(255, 222, 222)))

# ---- group: Result / Translucent Panels
preview = CustomPreview(Geometry=[item_6, item_7], Material=swatch_3)

# ---- group: Result / Transparent / Glass Panels
preview_2 = CustomPreview(Geometry=[item_5, item_4], Material=swatch)

# ---- group: Result / Space Frame
preview_3 = CustomPreview(Geometry=[multipipe, pipe], Material=swatch_2)
