# Grasshopper definition Eesha and Emily_M6 Distributions.gh (Grasshopper 1.0.7)
# plug-ins: Kangaroo2 Components

# ---- group: Surface Triangulate
# Using a defined base geometry, which in this project is an irregular surface, this program triangulates the surface to create s space-frame and shading devices within the frame.
# 
# Main Parameters
# Min Division Length: smallest length of triMesh division (low value makes more divisions)
# 
# Vert Factor: verticle displacement factor of brep
# 
# Member Thickness: thickness of each beam in the space-frame
# 
# Index: reference to a surface
# 
# Radius Top: the radius of the top circular opening of the shading device
# 
# Radius Bottom: the radius of the bottom circular opening of the shading device
min_division_length = Slider(5, range=0..100)
# Parameters
# 
# Min Division Length:length for each division
iterations = Slider(0, range=0..100)
# DEFINE SURFACE
boolean_toggle = BooleanToggle(True)
brep = Brep(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)
triremesh = TriRemesh(Geometry=brep, Sharp=boolean_toggle, Length=min_division_length, Iterations=iterations)  # -> Triangulation, Dual, Creases

# ---- group: Trianglation to Surface
# PANEL DESIGN
# This grouping divides the brep to a triangle surfaces, which each have an index.
# Indexes such as 0-10 and 91-96 should have flat shading devices.
# This grouping divides the brep to a triangle surfaces, which each have an index.
deconstruct_mesh = DeconstructMesh(Mesh=triremesh.Triangulation)  # -> Vertices, Faces, Colours, Normals
deconstruct_face = DeconstructFace(Face=deconstruct_mesh.Faces)  # -> CornerA, CornerB, CornerC, CornerD
list_item = ListItem(List=deconstruct_mesh.Vertices, Index=deconstruct_face.CornerC, Wrap=True)
list_item_2 = ListItem(List=deconstruct_mesh.Vertices, Index=deconstruct_face.CornerB, Wrap=True)
list_item_3 = ListItem(List=deconstruct_mesh.Vertices, Index=deconstruct_face.CornerA, Wrap=True)
_4point_surface = _4PointSurface(CornerA=list_item_3, CornerB=list_item_2, CornerC=list_item)
number_slider = Slider(91, range=0..140)

# ---- group: offsetSrf
# SPACE FRAME
# This grouping offsets the brep to begin adding dimentionality to the 2D brep surface.
# 
# These components copy and move the brep it to a position above the original brep in order to create a second list of between which to connect the space frame.
vert_factor = Slider(2, range=-10..10)
Z = UnitZ(Factor=vert_factor)
move = Move(Geometry=triremesh.Triangulation, Motion=Z)  # -> Geometry, Transform
entwine = Entwine(Branch00=move.Geometry, Branch01=triremesh.Triangulation, FlattenInputs=True)

# ----
# This grouping offsets the brep to begin adding dimentionality to the 2D brep surface
# 
# After defining the edges in the triangulared brep, the exterior and interior vertices are found. From these vertices, lines are drawn and the two trees (interior and exterior) are merdge to form the base lines of the form. These lines are then piped using the mulipipe tool to visually represent the space-frame as 3D.
mesh_edges = MeshEdges(Mesh=entwine)  # -> NakedEdges, InteriorEdges, NonManifoldEdges

# ---- group: Internal Members
explode = Explode(Curve=mesh_edges.InteriorEdges, Recursive=True)  # -> Segments, Vertices
shift_paths = ShiftPaths(Data=explode.Vertices, Offset=-1)
dispatch = Dispatch(List=shift_paths, DispatchPattern=[True, False])  # -> ListA, ListB
flip_matrix = FlipMatrix(Data=dispatch.ListB)
flip_matrix_2 = FlipMatrix(Data=dispatch.ListA)
list_item_4 = ListItem(List=flip_matrix, Index=0, Wrap=True)  # -> Item, Item1
list_item_5 = ListItem(List=flip_matrix_2, Index=0, Wrap=True)  # -> Item, Item1
line = Line(StartPoint=list_item_5.Item, EndPoint=list_item_5.Item1)
merge = Merge(Data1=mesh_edges.InteriorEdges, Data2=line)

# ---- group: Outer Members
explode_2 = Explode(Curve=mesh_edges.NakedEdges, Recursive=True)  # -> Segments, Vertices
shift_paths_2 = ShiftPaths(Data=explode_2.Vertices, Offset=-1)
flip_matrix_3 = FlipMatrix(Data=shift_paths_2)
list_item_6 = ListItem(List=flip_matrix_3, Index=0, Wrap=True)  # -> Item, Item1
line_2 = Line(StartPoint=list_item_6.Item, EndPoint=list_item_6.Item1)
merge_2 = Merge(Data1=mesh_edges.NakedEdges, Data2=line_2)

# ---- group: canvas construction of shade
# Parameter:
# Radius Bottom: radius of top shade opening
radius_bottom = Slider(1, range=0..10)

# Parameter:
# Radius Top: radius of top shade opening
radius_top = Slider(1, range=0..10)

# ---- group: bottomShade
item = ListItem(List=_4point_surface, Index=number_slider, Wrap=True)
panelwireframe = BrepWireframe(Brep=item, Density=-1)
item_2 = ListItem(List=panelwireframe, Index=Slider(1, range=0..1), Wrap=True)
midpt = CurveMiddle(Curve=item_2)
join = JoinCurves(Curves=panelwireframe, Preserve=False)

# ---- group: canvas construction of shade (continued)
area = Area(Geometry=item)  # -> Area, Centroid
srf_cp = SurfaceClosestPoint(Point=area.Centroid, Surface=item)  # -> Point, UVPoint, Distance
evalsrf = EvaluateSurface(Surface=item, Point=srf_cp.UVPoint)  # -> Point, Normal, UDirection, VDirection, Frame
vdis = VectorDisplay(Anchor=area.Centroid, Vector=evalsrf.UDirection)
circle = CircleCNR(Center=area.Centroid, Normal=evalsrf.Normal, Radius=radius_bottom)
multiplication = Multiplication(A=evalsrf.Normal, B=Slider(1, range=-10..10))
move_2 = Move(Geometry=area.Centroid, Motion=multiplication)  # -> Geometry, Transform
multiplication_2 = Multiplication(A=evalsrf.UDirection, B=radius_bottom)
move_3 = Move(Geometry=circle, Motion=multiplication)  # -> Geometry, Transform
move_4 = Move(Geometry=move_2.Geometry, Motion=multiplication_2)  # -> Geometry, Transform

# ---- group: bottomShade (continued)
ln = Line(StartPoint=midpt, EndPoint=move_4.Geometry)
bottom = Sweep2(Rail1=join, Rail2=move_3.Geometry, Sections=ln, SameHeight=False)

# ---- group: topShade
# Move surface 2 unit along z-axis to locate top shade.
item_3 = ListItem(List=_4point_surface, Index=number_slider, Wrap=True)
Z_2 = UnitZ(Factor=Slider(2, range=-10..10))
move_5 = Move(Geometry=item_3, Motion=Z_2)  # -> Geometry, Transform
panelwireframe_2 = BrepWireframe(Brep=move_5.Geometry, Density=-1)
item_4 = ListItem(List=panelwireframe_2, Index=Slider(1, range=0..1), Wrap=True)
midpt_2 = CurveMiddle(Curve=item_4)
join_2 = JoinCurves(Curves=panelwireframe_2, Preserve=False)

# ---- group: canvas construction of shade (continued)
area_2 = Area(Geometry=move_5.Geometry)  # -> Area, Centroid
srf_cp_2 = SurfaceClosestPoint(Point=area_2.Centroid, Surface=move_5.Geometry)  # -> Point, UVPoint, Distance
evalsrf_2 = EvaluateSurface(Surface=move_5.Geometry, Point=srf_cp_2.UVPoint)  # -> Point, Normal, UDirection, VDirection, Frame
multiplication_3 = Multiplication(A=evalsrf_2.Normal, B=Slider(-1, range=-10..10.001))
circle_2 = CircleCNR(Center=area_2.Centroid, Normal=evalsrf_2.Normal, Radius=radius_top)
vdis_2 = VectorDisplay(Anchor=area_2.Centroid, Vector=evalsrf_2.UDirection)
move_6 = Move(Geometry=circle_2, Motion=multiplication_3)  # -> Geometry, Transform
move_7 = Move(Geometry=area_2.Centroid, Motion=multiplication_3)  # -> Geometry, Transform
multiplication_4 = Multiplication(A=evalsrf_2.UDirection, B=radius_top)
move_8 = Move(Geometry=move_7.Geometry, Motion=multiplication_4)  # -> Geometry, Transform

# ---- group: topShade (continued)
ln_2 = Line(StartPoint=midpt_2, EndPoint=move_8.Geometry)
top = Sweep2(Rail1=join_2, Rail2=move_6.Geometry, Sections=ln_2, SameHeight=False)

# ----
merge_3 = Merge(Data1=merge_2, Data2=merge)  # -> flatten(Result)

# ---- group: Multipipe
# Parameters
# 
# Member thickness: change the thickness of the beams
# End o
member_thickness = Slider(0.1, range=0..0.1)
segment = Slider(0.2, range=0..1)
end_offset = Slider(0.05, range=0..0.1)
multipipe = MultiPipe(
    Curves=merge_3,
    NodeSize=member_thickness,
    EndOffset=end_offset,
    StrutSize=1,
    Segment=segment,
    KinkAngle=0.6,
    CubeFit=Toggle(False),
    Caps=0)

# ----
custom_preview = CustomPreview(Geometry=multipipe, Material=ColourSwatch(SwatchColor=RGB(135, 171, 170)))
